# Grasshopper definition 00-invisibledragon-material-construction.gh (Grasshopper 1.0.7)
# plug-ins: InvisibleDragon

mat = OpaqueMaterial(Name="Opaque Material", Conductivity=0.5, Density=800, SpecificHeat=1000)
thickness_m = Slider(0.1, range=0.01..1)
con = LayeredConstruction(Name="Layered Construction", Materials=mat, Thicknesses=thickness_m)  # -> Construction, UValue
u_value = Panel(con.UValue)
