# Grasshopper definition 02-invisibledragon-single-zone-hvac-idf.gh (Grasshopper 1.0.7)
# plug-ins: InvisibleDragon

run_explicit_rising_edge = Boolean(False)
south_window_boundary = Curve(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)
south_wall_boundary = Curve(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)
north_wall_boundary = Curve(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)
west_wall_boundary = Curve(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)
east_wall_boundary = Curve(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)
cancel_active_run = Boolean(False)
floor_boundary = Curve(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)
roof_boundary = Curve(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)
force_rerun = Boolean(False)
epw_file = FilePath()
mat = OpaqueMaterial(Name="Opaque Material", Conductivity=0.5, Density=800, SpecificHeat=1000)
envelope_0_200_m = Slider(0.2, range=0.01..0.5)
layer = ConstructionLayer(Material=mat, Thickness=envelope_0_200_m)
con = LayeredConstruction(Name="Layered Construction", Layers=layer)  # -> Construction, UValue
prof = ConstantProfile(Name="Basic Profile", HeatingSetpoint=20, CoolingSetpoint=26, Occupancy=0)  # -> Profile, Diagnostics
glass = Glazing(Name="Glazing", UValue=1.5, SHGC=0.5)
window = WindowFromPolyline(Curve=south_window_boundary, Name="Window", Glazing=glass)
floor_name = Panel("Floor")
roof_name = Panel("Roof")
south_wall_name = Panel("South Wall")
surface = Surface(
    Curve=south_wall_boundary,
    Name=south_wall_name,
    Type="Wall",
    Construction=con.Construction,
    BoundaryIntent="Outdoors",
    Openings=window)  # -> Surface, GrossArea, NetArea, Valid, Diagnostics
north_wall_name = Panel("North Wall")
surface_2 = Surface(Curve=north_wall_boundary, Name=north_wall_name, Type="Wall", Construction=con.Construction, BoundaryIntent="Outdoors")  # -> Surface, GrossArea, NetArea, Valid, Diagnostics
west_wall_name = Panel("West Wall")
surface_3 = Surface(Curve=west_wall_boundary, Name=west_wall_name, Type="Wall", Construction=con.Construction, BoundaryIntent="Outdoors")  # -> Surface, GrossArea, NetArea, Valid, Diagnostics
east_wall_name = Panel("East Wall")
surface_4 = Surface(Curve=east_wall_boundary, Name=east_wall_name, Type="Wall", Construction=con.Construction, BoundaryIntent="Outdoors")  # -> Surface, GrossArea, NetArea, Valid, Diagnostics
floor_type = Panel("Floor")
ceiling_type = Panel("Ceiling")
surface_5 = Surface(Curve=roof_boundary, Name=roof_name, Type=ceiling_type, Construction=con.Construction, BoundaryIntent="Outdoors")  # -> Surface, GrossArea, NetArea, Valid, Diagnostics
ground_boundary = Panel("Ground")
surface_6 = Surface(Curve=floor_boundary, Name=floor_name, Type=floor_type, Construction=con.Construction, BoundaryIntent=ground_boundary)  # -> Surface, GrossArea, NetArea, Valid, Diagnostics
heatpump = HeatPump(Name="Heat Pump", Fuel=0, HeatingCOP=3.5, CoolingCOP=4, HeatingCapacity=0, CoolingCapacity=0)
ahu = AirHandlingUnit(Name="Air Handling Unit", HeatPump=heatpump, FanTotalEfficiency=0.7, FanPressureRise=100, MotorEfficiency=0.9)
boiler = Boiler(Name="Boiler", Fuel=1, ThermalEfficiency=0.9, NominalCapacity=0, PumpMotorEfficiency=0.9, HotWaterSetpoint=60)
radiantfloor = RadiantFloor(Name="Radiant Floor", HydronicSource=boiler, ThrottlingRange=2)
erv = EnergyRecoveryVentilator(
    Name="Energy Recovery Ventilator",
    SensibleEffectiveness=0.75,
    LatentEffectiveness=0.65,
    SupplyAirFlow=0,
    FanTotalEfficiency=0.7,
    FanPressureRise=100)
zone = ThermalZone(
    Name="Zone",
    Surfaces=[surface_6.Surface, surface_5.Surface, surface.Surface, surface_2.Surface, surface_3.Surface, surface_4.Surface],
    Profile=prof.Profile,
    Infiltration=0,
    LightingPowerDensity=0,
    OutdoorAirFlow=0,
    HVAC=[ahu, radiantfloor],
    ERVs=erv)  # -> Zone, Valid, Diagnostics
pv = PhotovoltaicPanel(Name="Photovoltaic Panel", Area=10, Tilt=30, Azimuth=180, Efficiency=0.2, ActiveCellAreaFraction=0.7)
model = EnergyModel(Name="InvisibleDragon Model", Zones=zone.Zone, NorthAxis=0, Terrain="Suburbs", PVPanels=pv)  # -> Model, Valid, Diagnostics
id_to_idf = CompileInvisibleDragon(Model=model.Model)  # -> IDF, Text, Valid, Diagnostics
compiled_idf = Panel(id_to_idf.Text)
managed_idf_validation = Panel(id_to_idf.Valid)
compilation_diagnostics = Panel(id_to_idf.Diagnostics)
id_weather = VerifyInvisibleDragonWeather(EPWFile=epw_file)  # -> Weather, Success, Diagnostics
weather_verified = Panel(id_weather.Success)
weather_diagnostics = Panel(id_weather.Diagnostics)
run_timeout_30_min = Slider(30, range=1..120)
run = RunInvisibleDragon(
    IDF=id_to_idf.IDF,
    Weather=id_weather.Weather,
    Run=run_explicit_rising_edge,
    Cancel=cancel_active_run,
    ForceRerun=force_rerun,
    Timeout=run_timeout_30_min)  # -> Result, State, Success, Diagnostics
energyplus_result = Panel(run.Result)
invisibledragon_run_state = Panel(run.State)
invisibledragon_run_success = Panel(run.Success)
run_diagnostics = Panel(run.Diagnostics)
