# Grasshopper definition 12-simpledragon-two-zone-to-idf.gh (Grasshopper 1.0.7)
# plug-ins: SimpleDragon

two_closed_office_zones = Brep([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])
south_facade_windows = Curve([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])
opening_zone_indices = Integer([0, 1])
opening_face_indices = Integer([0, 0])
# Rhino source model: Open 30-two-zone-office.3dm; relink by object names when live references are preferred.
packaged_office_profile = Panel("소규모사무실")
sd_profile = LookupSimpleDragonUsageProfile(Name=packaged_office_profile)  # -> Profile, AvailableNames, Diagnostics
sd_material = SimpleDragonMaterial(Name="Simple Material", Conductivity=0.04, Density=30, SpecificHeat=1400)
envelope_0_200_m = Slider(0.2, range=0.01..0.5)
sd_construction = SimpleDragonSurfaceConstruction(Name="Simple Construction", Materials=sd_material, Thicknesses=envelope_0_200_m)  # -> Construction, UValue
sd_fenestration = SimpleDragonFenestrationConstruction(Name="Simple Window", UValue=1.5, SHGC=0.5)  # -> Construction, Transparent
sd_zones = ExtractSimpleDragonZones(
    ZoneBreps=two_closed_office_zones,
    Profile=sd_profile.Profile,
    SurfaceConstruction=sd_construction.Construction,
    FenestrationConstruction=sd_fenestration.Construction,
    UnmatchedFloorBoundary="Ground",
    LightingPowerDensity=10,
    OpeningCurves=south_facade_windows,
    OpeningZoneIndices=opening_zone_indices,
    OpeningFaceIndices=opening_face_indices)  # -> Zones, Surfaces, GeometryMap, Diagnostics, GeometryMapData
sd_heat_pump = SimpleDragonHeatPump(Name="Heat Pump", Fuel=0, HeatingCOP=3, CoolingCOP=3)  # -> Source, Diagnostics
sd_ahu = SimpleDragonAirHandlingUnit(Name="Air Handling Unit", Source=sd_heat_pump.Source)  # -> Supply, Diagnostics
sd_boiler = SimpleDragonBoiler(Name="Boiler", Fuel=1, Efficiency=0.85, HotWaterSupply=False)  # -> Source, Diagnostics
sd_radiator = SimpleDragonRadiator(Name="Radiator", Source=sd_boiler.Source)  # -> Supply, Diagnostics
assign_sd_supplies = AssignSimpleDragonSupplySystems(Zone=sd_zones.Zones, Supplies=[sd_ahu.Supply, sd_radiator.Supply], ReplaceExisting=False)  # -> Zone, Diagnostics
sd_erv = SimpleDragonEnergyRecoveryVentilator(Name="Energy Recovery Ventilator", Airflow=0.2, HeatingEfficiency=0.7, CoolingEfficiency=0.45)  # -> ERV, Diagnostics
assign_sd_ervs = AssignSimpleDragonVentilationSystems(Zone=assign_sd_supplies.Zone, ERVs=sd_erv.ERV, ReplaceExisting=False)  # -> Zone, Diagnostics
sd_pv = SimpleDragonPhotovoltaicPanel(Name="Photovoltaic Panel", Area=10, Efficiency=0.2, Azimuth=180, Tilt=30)  # -> PV, Diagnostics
assemble_grm = AssembleSimpleDragonGRM(
    Name="SimpleDragon Model",
    Zones=assign_sd_ervs.Zone,
    NorthAxis=0,
    Address="서울특별시 종로구",
    Vintage="2020-01-01",
    MultifamilyHousing=False,
    Materials=sd_material,
    SurfaceConstructions=sd_construction.Construction,
    FenestrationConstructions=sd_fenestration.Construction,
    SourceSystems=[sd_heat_pump.Source, sd_boiler.Source],
    SupplySystems=[sd_ahu.Supply, sd_radiator.Supply],
    ERVSystems=sd_erv.ERV,
    PhotovoltaicPanels=sd_pv.PV)  # -> GRM, JSON, FloorArea, Diagnostics
grm_to_idf = ConvertSimpleDragonGRM(GRM=assemble_grm.GRM)  # -> EnergyModel, IDF, IDFText, EPWFile, Success, Diagnostics
geometry_provenance_map = Panel(sd_zones.GeometryMap)
total_floor_area = Panel(assemble_grm.FloorArea)
converted_idf = Panel(grm_to_idf.IDFText)
conversion_success = Panel(grm_to_idf.Success)
