# Grasshopper definition 13-simpledragon-results-and-plots.gh (Grasshopper 1.0.7)
# plug-ins: SimpleDragon

grr_fixture_path = FilePath("..\fixtures\simple-dragon\grr\ASHRAE 140 modified.grr")
read_grr = ReadSimpleDragonGRR(Path=grr_fixture_path)  # -> GRR, CanonicalJSON, Success, Diagnostics
grr_summary = SimpleDragonGRRSummary(GRR=read_grr.GRR, Metric="SiteUses", Gross=False)  # -> TotalArea, AnnualTotal, MonthlyTotals, Carriers, CarrierTotals, EndUses, EndUseTotals, Basis
grr_tree = SimpleDragonGRRDataTree(GRR=read_grr.GRR, Metric="SiteUses", Gross=False, Grouping="Fuel")  # -> SeriesNames, MonthNames, XValues, YValues, Unit, CSV
monthly_lines = SimpleDragonMonthlyLinePlot(GRR=read_grr.GRR, Metric="SiteUses", Gross=False, Grouping="Fuel", Plane=PlaneXY(0, 0, 0), Width=12, Height=6)  # -> Lines, Frame, ZeroAxis, SeriesNames, MonthNames, XValues, YValues, Unit
monthly_bars = SimpleDragonMonthlyBarPlot(
    GRR=read_grr.GRR,
    Metric="SiteUses",
    Gross=False,
    Grouping="Fuel",
    Plane=PlaneXY(0, 0, 0),
    Width=12,
    Height=6,
    Stacked=False)  # -> Bars, Frame, ZeroAxis, SeriesNames, MonthNames, XValues, YValues, Unit
preview_export_directory = Panel("..\temp\example-preview\simpledragon-csv")
export_csv = ExportSimpleDragonCSV(GRR=read_grr.GRR, Directory=preview_export_directory, Export=False, Overwrite=False)  # -> FullDirectory, FileNames, FilePaths, Content, Written
annual_site_use = Panel(grr_summary.AnnualTotal)
monthly_data_tree = Panel(grr_tree.YValues)
line_plot_curves = Panel(monthly_lines.Lines)
bar_plot_curves = Panel(monthly_bars.Bars)
csv_preview_files = Panel(export_csv.FileNames)
